# Grasshopper definition generator_2.gh (Grasshopper 1.0.8)
# plug-ins: RhinoCodePluginGH

geo = Geometry([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])  # disabled
geo_2 = Geometry([<brep referenced from the Rhino model> x2, <curve referenced from the Rhino model>, <extrusion referenced from the Rhino model>])
geo_3 = Geometry(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)  # disabled
relay = Relay([geo, geo_3])
geo_4 = Geometry([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])
geo_5 = Geometry(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)
geo_6 = Geometry(<surface referenced from the Rhino model>)
geo_7 = Geometry(<surface referenced from the Rhino model>)
geo_8 = Geometry(<brep referenced from the Rhino model>)
geo_9 = Geometry(<brep referenced from the Rhino model>)
circle = Circle({Plane=Plane(origin=(430.1117644, 77.22441841, 142.674658), x=(0.3634222938, 0.9316245147, 0), y=(-0.9316245147, 0.3634222938, 0)), Radius=21.10023932})
number_slider = Slider(45, range=0..100)
merge = Merge(Data1=geo_6, Data2=geo_7, Data3=geo_8, Data4=geo_9)
volume = Volume(Geometry=geo_6)  # -> Volume, Centroid
core = Python3Script(L=number_slider)  # -> out, Cube, Pts, VtxPlanes
# ---------- core: Python ----------
import Rhino.Geometry as rg
import math

# Grasshopper input:
#   L (float) edge length, default = 2
# Grasshopper output:
#   Cube (Brep)
#   Pts (list[Point3d])
#   VtxPlanes (list[Plane])  # plane at each vertex

if L is None or L <= 0:
    L = 2.0

s = float(L)

# Cube vertices (centered at origin for symmetry)
# 8 corners at (±s/2, ±s/2, ±s/2)
h = s / 2.0
vertices = [
    rg.Point3d(-h, -h, -h),  # 0
    rg.Point3d( h, -h, -h),  # 1
    rg.Point3d( h,  h, -h),  # 2
    rg.Point3d(-h,  h, -h),  # 3
    rg.Point3d(-h, -h,  h),  # 4
    rg.Point3d( h, -h,  h),  # 5
    rg.Point3d( h,  h,  h),  # 6
    rg.Point3d(-h,  h,  h),  # 7
]

Pts = vertices

# Build cube using Rhino Box primitive
base_plane = rg.Plane(rg.Point3d(-h, -h, -h), rg.Vector3d.XAxis, rg.Vector3d.YAxis)
box = rg.Box(base_plane, rg.Interval(0, s), rg.Interval(0, s), rg.Interval(0, s))
Cube = box.ToBrep()

# Cube center (at origin)
center = rg.Point3d(0, 0, 0)

def make_vertex_plane(origin, center_pt):
    # Z axis: vector from center to vertex
    z = rg.Vector3d(origin.X - center_pt.X, origin.Y - center_pt.Y, origin.Z - center_pt.Z)
    if not z.Unitize():
        # fallback (shouldn't happen)
        z = rg.Vector3d.ZAxis

    # Pick a reference vector not parallel to z, to construct X/Y
    ref = rg.Vector3d.ZAxis
    if abs(rg.Vector3d.Multiply(z, ref)) > 0.999:  # nearly parallel
        ref = rg.Vector3d.XAxis

    x = rg.Vector3d.CrossProduct(ref, z)
    if not x.Unitize():
        x = rg.Vector3d.XAxis

    y = rg.Vector3d.CrossProduct(z, x)
    if not y.Unitize():
        y = rg.Vector3d.YAxis

    return rg.Plane(origin, x, y)

VtxPlanes = [make_vertex_plane(p, center) for p in Pts]
# ---------- end core ----------
core_2 = Python3Script(R=number_slider)  # -> out, Tetra, Pts, VtxPlanes
# ---------- core_2: Python ----------
import Rhino.Geometry as rg
import math

# Grasshopper input:
#   R (float) circumradius, default = 2
# Grasshopper output:
#   Tetra (Brep)
#   Pts (list[Point3d])
#   VtxPlanes (list[Plane])

if R is None or R <= 0:
    R = 2.0

r = float(R)

# -----------------------------------------
# Regular tetrahedron with one face on XY plane
# Input = circumradius R
# -----------------------------------------

# Edge length from circumradius
L = 4.0 * r / math.sqrt(6.0)

# Base equilateral triangle on XY plane
Rb = L / math.sqrt(3.0)            # circumradius of base triangle
H = math.sqrt(2.0 / 3.0) * L       # tetrahedron height

# Base vertices (centered around origin in XY)
p0 = rg.Point3d(Rb, 0, 0)
p1 = rg.Point3d(Rb * math.cos(2.0 * math.pi / 3.0),
                Rb * math.sin(2.0 * math.pi / 3.0), 0)
p2 = rg.Point3d(Rb * math.cos(4.0 * math.pi / 3.0),
                Rb * math.sin(4.0 * math.pi / 3.0), 0)

# Apex above base center
p3 = rg.Point3d(0, 0, H)

vertices = [p0, p1, p2, p3]
Pts = vertices

# -----------------------------------------
# Build closed Brep
# -----------------------------------------
tol = 0.001

face_indices = [
    (0, 1, 2),  # base
    (0, 3, 1),
    (1, 3, 2),
    (2, 3, 0)
]

faces = []
for a, b, c in face_indices:
    brep = rg.Brep.CreateFromCornerPoints(vertices[a], vertices[b], vertices[c], tol)
    if brep:
        faces.append(brep)

joined = rg.Brep.JoinBreps(faces, tol)
Tetra = joined[0] if joined and len(joined) > 0 else None

# -----------------------------------------
# Circumsphere center
# For a regular tetrahedron with base on z=0 and apex at z=H,
# sphere center lies on the symmetry axis at z = H/4
# -----------------------------------------
center = rg.Point3d(0, 0, H / 4.0)

def make_vertex_plane(origin, center_pt):
    # Z axis: vector from sphere center to vertex
    z = origin - center_pt
    if not z.Unitize():
        z = rg.Vector3d.ZAxis

    ref = rg.Vector3d.ZAxis
    if abs(rg.Vector3d.Multiply(z, ref)) > 0.999:
        ref = rg.Vector3d.XAxis

    x = rg.Vector3d.CrossProduct(ref, z)
    if not x.Unitize():
        x = rg.Vector3d.XAxis

    y = rg.Vector3d.CrossProduct(z, x)
    if not y.Unitize():
        y = rg.Vector3d.YAxis

    return rg.Plane(origin, x, y)

VtxPlanes = [make_vertex_plane(p, center) for p in Pts]
# ---------- end core_2 ----------
core_3 = Python3Script(L=number_slider)  # -> out, Geo, Pts, VtxPlanes
# ---------- core_3: Python ----------
import Rhino.Geometry as rg
import math

# Grasshopper input:
#   L (float) edge length, default = 2
# Grasshopper output:
#   Geo (Brep)                # kept same name for compatibility
#   Pts (list[Point3d])
#   VtxPlanes (list[Plane])    # plane at each vertex

if L is None or L <= 0:
    L = 2.0

s = float(L)

# -----------------------------------------
# Regular triangular bipyramid geometry
# -----------------------------------------
# Base equilateral triangle on XY plane, centered at origin
# Apexes on +Z and -Z
#
# For a regular triangular bipyramid:
# circumradius of base triangle = s / sqrt(3)
# apex height from center of base = sqrt(2/3) * s
# -----------------------------------------

R = s / math.sqrt(3.0)
h = math.sqrt(2.0 / 3.0) * s

# 5 vertices
vertices = [
    rg.Point3d(R, 0, 0),                                              # 0 base
    rg.Point3d(R * math.cos(2.0 * math.pi / 3.0),
               R * math.sin(2.0 * math.pi / 3.0), 0),                 # 1 base
    rg.Point3d(R * math.cos(4.0 * math.pi / 3.0),
               R * math.sin(4.0 * math.pi / 3.0), 0),                 # 2 base
    rg.Point3d(0, 0, h),                                              # 3 top apex
    rg.Point3d(0, 0, -h)                                              # 4 bottom apex
]

Pts = vertices

# -----------------------------------------
# Build closed Brep from 6 triangular faces
# -----------------------------------------
tol = 0.001

face_indices = [
    (3, 0, 1),
    (3, 1, 2),
    (3, 2, 0),
    (4, 1, 0),
    (4, 2, 1),
    (4, 0, 2)
]

faces = []
for a, b, c in face_indices:
    brep = rg.Brep.CreateFromCornerPoints(vertices[a], vertices[b], vertices[c], tol)
    if brep:
        faces.append(brep)

joined = rg.Brep.JoinBreps(faces, tol)
Geo = joined[0] if joined and len(joined) > 0 else None

# -----------------------------------------
# Geometry center
# Since this regular triangular bipyramid is centered at origin
# -----------------------------------------
center = rg.Point3d(0, 0, 0)

def make_vertex_plane(origin, center_pt):
    # Z axis: vector from center to vertex
    z = rg.Vector3d(origin.X - center_pt.X, origin.Y - center_pt.Y, origin.Z - center_pt.Z)
    if not z.Unitize():
        z = rg.Vector3d.ZAxis

    # Pick a reference vector not parallel to z
    ref = rg.Vector3d.ZAxis
    if abs(rg.Vector3d.Multiply(z, ref)) > 0.999:
        ref = rg.Vector3d.XAxis

    x = rg.Vector3d.CrossProduct(ref, z)
    if not x.Unitize():
        x = rg.Vector3d.XAxis

    y = rg.Vector3d.CrossProduct(z, x)
    if not y.Unitize():
        y = rg.Vector3d.YAxis

    return rg.Plane(origin, x, y)

VtxPlanes = [make_vertex_plane(p, center) for p in Pts]
# ---------- end core_3 ----------
Z = UnitZ(Factor=Slider(7.1717, range=-30..30))
brep = Brep(core_3.Geo)
brep_2 = Brep(core_2.Tetra)
balloon_generator = Python3Script(C=circle, d=[Slider(20, range=0..100), Slider(20, range=0..100), Slider(20, range=0..100), Slider(20, range=0..100)])  # -> out, S, Center, Trimmed, CutPlane
# ---------- balloon_generator: Python ----------
import Rhino.Geometry as rg
import math

# Inputs:
# C : Circle
# d : float (distance from sphere center to circle center)

# Outputs:
# S       : Sphere
# Center  : Point3d
# Trimmed : Brep
# CutPlane: Plane

tol = 1e-6

S = None
Center = None
Trimmed = None
CutPlane = None

if C is not None:
    r = C.Radius
    plane = C.Plane
    CutPlane = plane

    # Sphere radius: R^2 = r^2 + d^2
    R = math.sqrt(r * r + d * d)

    # Sphere center: along circle plane normal
    Center = plane.Origin + plane.ZAxis * d
    S = rg.Sphere(Center, R)

    sphere_brep = S.ToBrep()

    # Make a sufficiently large cutting plane surface
    size = R * 4.0 + r * 4.0 + abs(d) * 2.0
    udom = rg.Interval(-size, size)
    vdom = rg.Interval(-size, size)
    cutter = rg.PlaneSurface(plane, udom, vdom).ToBrep()

    # Split sphere by the circle plane
    pieces = sphere_brep.Split(cutter, tol)

    if pieces and len(pieces) > 0:
        kept = None

        # Keep the piece on the same side as the sphere center
        # relative to the cutting plane
        for piece in pieces:
            amp = rg.AreaMassProperties.Compute(piece)
            if amp is None:
                continue

            c = amp.Centroid
            vec = c - plane.Origin

            # signed distance direction test
            side = rg.Vector3d.Multiply(vec, plane.ZAxis)

            # sphere center is always on the side indicated by d
            # if d >= 0, keep positive side; if d < 0, keep negative side
            if d >= 0 and side >= -tol:
                kept = piece
                break
            elif d < 0 and side <= tol:
                kept = piece
                break

        # fallback: choose the piece whose centroid is closer to the sphere center
        if kept is None:
            best_dist = None
            for piece in pieces:
                amp = rg.AreaMassProperties.Compute(piece)
                if amp is None:
                    continue
                dist = amp.Centroid.DistanceTo(Center)
                if best_dist is None or dist < best_dist:
                    best_dist = dist
                    kept = piece

        Trimmed = kept
# ---------- end balloon_generator ----------
move = Move(Geometry=balloon_generator.CutPlane, Motion=expr("-x", Z))  # -> Geometry, Transform
move_2 = Move(Geometry=balloon_generator.CutPlane, Motion=Z)  # -> Geometry, Transform
pln = Plane(move_2.Geometry)
brep_3 = Brep(balloon_generator.Trimmed)
pflip = FlipPlane(Plane=pln, ReverseX=False, ReverseY=False, SwapAxes=True)
brep_4 = Brep(brep_2)
orient = Orient(Geometry=graft(merge), Source=pflip, Target=core_2.VtxPlanes)  # -> Geometry, Transform
orient_2 = Orient(Geometry=brep_3, Source=move.Geometry, Target=core_2.VtxPlanes)  # -> Geometry, Transform
debrep = DeconstructBrep(Brep=brep_4)  # -> Faces, Edges, Vertices
volume_2 = Volume(Geometry=brep_4)  # -> Volume, Centroid
curvepoint = PointOnCurve(debrep.Edges, parameter=0.5)
number_slider_2 = Slider(-9.352, range=-20..20)
vec2pt = Vector2Pt(PointA=volume_2.Centroid, PointB=curvepoint, Unitize=False)  # -> Vector, Length
amp = Amplitude(Vector=vec2pt.Vector, Amplitude=Slider(14.79, range=0..100))
ext = ExtendCurve(Curve=debrep.Edges, Type=0, Start=number_slider_2, End=number_slider_2)
move_3 = Move(Geometry=curvepoint, Motion=amp)  # -> graft(Geometry), Transform
explode = Explode(Curve=ext, Recursive=True)  # -> Segments, Vertices
item = ListItem(List=explode.Vertices, Index=0, Wrap=True)  # -> Item, Item1
vec2pt_2 = Vector2Pt(PointA=item.Item, PointB=item.Item1, Unitize=False)  # -> flatten(Vector), Length
pl = ConstructPlane(Origin=curvepoint, XAxis=vec2pt_2.Vector, YAxis=vec2pt.Vector)
deplane = DeconstructPlane(Plane=pl)  # -> Origin, XAxis, YAxis, ZAxis

crv = Curve(<curve referenced from the Rhino model>)
explode_2 = Explode(Curve=crv, Recursive=True)  # -> Segments, Vertices
item_2 = ListItem(List=explode_2.Vertices, Index=0, Wrap=True)

pl_2 = ConstructPlane(Origin=curvepoint, XAxis=deplane.ZAxis, YAxis=deplane.XAxis)  # -> graft(Plane)
arc = Arc3Pt(PointA=item.Item, PointB=move_3.Geometry, PointC=item.Item1)  # -> Arc, Plane, Radius
pl_origin = PlaneOrigin(Base=pl_2, Origin=item.Item1)
pl_origin_2 = PlaneOrigin(Base=pl_2, Origin=item.Item)
pflip_2 = FlipPlane(Plane=pl_origin, ReverseX=False, ReverseY=True, SwapAxes=False)
orient_3 = Orient(Geometry=crv, Source=item_2, Target=pl_origin_2)  # -> Geometry, Transform
cluster = Cluster(G=pl_origin_2, D=Slider(-34, range=-180..180), C=pl_origin_2, P=pl_origin_2)
cluster_2 = Cluster(G=pflip_2, D=Slider(0, range=-180..180), C=pflip_2, P=pflip_2)
orient_4 = Orient(Geometry=crv, Source=item_2, Target=cluster_2)  # -> Geometry, Transform
orient_5 = Orient(Geometry=crv, Source=item_2, Target=cluster)  # -> Geometry, Transform
flip = FlipMatrix(Data=orient.Geometry)
swp2 = Sweep2(Rail1=orient_3.Geometry, Rail2=orient_4.Geometry, Sections=arc.Arc, SameHeight=False)
swp1 = Sweep1(Rail=arc.Arc, Sections=orient_5.Geometry, Miter=1)
item_3 = ListItem(List=flip, Index=Slider(1, range=0..10), Wrap=True)
panel = Panel(item_3)
item_4 = ListItem(List=flip, Index=Slider(0, range=0..10), Wrap=True)
pi = Pi(Factor=1)
yz = YZPlane(Origin=volume_2.Centroid)
cap = CapHoles(Brep=swp1)
sdiff = SolidDifference(BrepsA=flatten(cap), BrepsB=flatten(item_4))
sunion = SolidUnion(Breps=flatten([sdiff, item_3]))
rotate = Rotate(Geometry=sunion, Angle=expr("-x", pi), Plane=yz)  # -> Geometry, Transform
sunion_2 = SolidUnion(Breps=flatten([sunion, rotate.Geometry]))
group = Group(Objects=flatten(orient.Geometry))
group_2 = Group(Objects=orient_2.Geometry)
rotate_2 = Rotate(Geometry=group_2, Angle=pi, Plane=yz)  # -> Geometry, Transform
group_3 = Group(Objects=sunion)
rotate_3 = Rotate(Geometry=group, Angle=pi, Plane=yz)  # -> Geometry, Transform

# ==== cluster Cluster
D = ClusterInput()
P = ClusterInput()
G = ClusterInput()
C = ClusterInput()
rad = Radians(Degrees=D)
deplane = DeconstructPlane(Plane=P)  # -> Origin, XAxis, YAxis, ZAxis
rot3d = Rotate3D(Geometry=G, Angle=rad, Center=C, Axis=deplane.XAxis)  # -> Geometry, Transform
G_2 = ClusterOutput(rot3d.Geometry)
