# Grasshopper definition generator_exploded.gh (Grasshopper 1.0.8)
# plug-ins: RhinoCodePluginGH

sphere = Geometry(<surface referenced from the Rhino model>)
connector = Geometry(<surface referenced from the Rhino model>)
plate = Geometry(<brep referenced from the Rhino model>)
ring = Geometry(<brep referenced from the Rhino model>)
circle = Circle({Plane=Plane(origin=(430.1117644, 77.22441841, 142.674658), x=(0.3634222938, 0.9316245147, 0), y=(-0.9316245147, 0.3634222938, 0)), Radius=21.10023932})
number_slider = Slider(45, range=0..100)
merge = Merge(Data1=sphere, Data2=connector, Data3=plate, Data4=ring)

# ---- group: individual control for balloon scales
merge_2 = Merge(
    Data1=Slider(20, range=0..100),
    Data2=Slider(20, range=0..100),
    Data3=Slider(20, range=0..100),
    Data4=Slider(20, range=0..100),
    Data5=Slider(20, range=0..100),
    Data6=Slider(20, range=0..100),
    Data7=Slider(20, range=0..100),
    Data8=Slider(20, range=0..100))

# ---- group: input geometry
circle_2 = Circle({Plane=Plane(origin=(430.1117644, 77.22441841, 142.674658), x=(0.3634222938, 0.9316245147, 0), y=(-0.9316245147, 0.3634222938, 0)), Radius=21.10023932})
sphere_2 = Geometry(<surface referenced from the Rhino model>)
connector_2 = Geometry(<surface referenced from the Rhino model>)
plate_2 = Geometry(<brep referenced from the Rhino model>)
ring_2 = Geometry(<brep referenced from the Rhino model>)

# ----
merge_3 = Merge(Data1=sphere_2, Data2=connector_2, Data3=plate_2, Data4=ring_2)
volume = Volume(Geometry=sphere_2)  # -> Volume, Centroid
core = Python3Script(R=number_slider)  # -> out, Tetra, Pts, VtxPlanes
# ---------- core: Python ----------
import Rhino.Geometry as rg
import math

# Grasshopper input:
#   R (float) circumradius, default = 2
# Grasshopper output:
#   Tetra (Brep)
#   Pts (list[Point3d])
#   VtxPlanes (list[Plane])

if R is None or R <= 0:
    R = 2.0

r = float(R)

# -----------------------------------------
# Regular tetrahedron with one face on XY plane
# Input = circumradius R
# -----------------------------------------

# Edge length from circumradius
L = 4.0 * r / math.sqrt(6.0)

# Base equilateral triangle on XY plane
Rb = L / math.sqrt(3.0)            # circumradius of base triangle
H = math.sqrt(2.0 / 3.0) * L       # tetrahedron height

# Base vertices (centered around origin in XY)
p0 = rg.Point3d(Rb, 0, 0)
p1 = rg.Point3d(Rb * math.cos(2.0 * math.pi / 3.0),
                Rb * math.sin(2.0 * math.pi / 3.0), 0)
p2 = rg.Point3d(Rb * math.cos(4.0 * math.pi / 3.0),
                Rb * math.sin(4.0 * math.pi / 3.0), 0)

# Apex above base center
p3 = rg.Point3d(0, 0, H)

vertices = [p0, p1, p2, p3]
Pts = vertices

# -----------------------------------------
# Build closed Brep
# -----------------------------------------
tol = 0.001

face_indices = [
    (0, 1, 2),  # base
    (0, 3, 1),
    (1, 3, 2),
    (2, 3, 0)
]

faces = []
for a, b, c in face_indices:
    brep = rg.Brep.CreateFromCornerPoints(vertices[a], vertices[b], vertices[c], tol)
    if brep:
        faces.append(brep)

joined = rg.Brep.JoinBreps(faces, tol)
Tetra = joined[0] if joined and len(joined) > 0 else None

# -----------------------------------------
# Circumsphere center
# For a regular tetrahedron with base on z=0 and apex at z=H,
# sphere center lies on the symmetry axis at z = H/4
# -----------------------------------------
center = rg.Point3d(0, 0, H / 4.0)

def make_vertex_plane(origin, center_pt):
    # Z axis: vector from sphere center to vertex
    z = origin - center_pt
    if not z.Unitize():
        z = rg.Vector3d.ZAxis

    ref = rg.Vector3d.ZAxis
    if abs(rg.Vector3d.Multiply(z, ref)) > 0.999:
        ref = rg.Vector3d.XAxis

    x = rg.Vector3d.CrossProduct(ref, z)
    if not x.Unitize():
        x = rg.Vector3d.XAxis

    y = rg.Vector3d.CrossProduct(z, x)
    if not y.Unitize():
        y = rg.Vector3d.YAxis

    return rg.Plane(origin, x, y)

VtxPlanes = [make_vertex_plane(p, center) for p in Pts]
# ---------- end core ----------
core_2 = Python3Script(R=number_slider)  # -> out, Bipyra, Pts, VtxPlanes
# ---------- core_2: Python ----------
import Rhino.Geometry as rg
import math

# Grasshopper input:
#   R (float) circumradius, default = 2
# Grasshopper output:
#   Bipyra (Brep)                # kept name for compatibility
#   Pts (list[Point3d])
#   VtxPlanes (list[Plane])

if R is None or R <= 0:
    R = 2.0

r = float(R)

# -----------------------------------------
# Triangular Bipyramid (cospherical)
# All 5 vertices lie on sphere of radius R
# -----------------------------------------

# Base triangle on XY plane (equator)
p0 = rg.Point3d(r, 0, 0)
p1 = rg.Point3d(r * math.cos(2.0 * math.pi / 3.0),
                r * math.sin(2.0 * math.pi / 3.0), 0)
p2 = rg.Point3d(r * math.cos(4.0 * math.pi / 3.0),
                r * math.sin(4.0 * math.pi / 3.0), 0)

# Apex points
ptop = rg.Point3d(0, 0, r)
pbot = rg.Point3d(0, 0, -r)

vertices = [p0, p1, p2, ptop, pbot]
Pts = vertices

# -----------------------------------------
# Build faces
# -----------------------------------------
tol = 0.001

face_indices = [
    (3, 0, 1),
    (3, 1, 2),
    (3, 2, 0),
    (4, 1, 0),
    (4, 2, 1),
    (4, 0, 2)
]

faces = []
for a, b, c in face_indices:
    brep = rg.Brep.CreateFromCornerPoints(vertices[a], vertices[b], vertices[c], tol)
    if brep:
        faces.append(brep)

joined = rg.Brep.JoinBreps(faces, tol)
Bipyra = joined[0] if joined and len(joined) > 0 else None

# -----------------------------------------
# Center
# -----------------------------------------
center = rg.Point3d(0, 0, 0)

def make_vertex_plane(origin, center_pt):
    z = origin - center_pt
    if not z.Unitize():
        z = rg.Vector3d.ZAxis

    ref = rg.Vector3d.ZAxis
    if abs(rg.Vector3d.Multiply(z, ref)) > 0.999:
        ref = rg.Vector3d.XAxis

    x = rg.Vector3d.CrossProduct(ref, z)
    if not x.Unitize():
        x = rg.Vector3d.XAxis

    y = rg.Vector3d.CrossProduct(z, x)
    if not y.Unitize():
        y = rg.Vector3d.YAxis

    return rg.Plane(origin, x, y)

VtxPlanes = [make_vertex_plane(p, center) for p in Pts]
# ---------- end core_2 ----------
core_3 = Python3Script(R=number_slider)  # -> out, Octa, Pts, VtxPlanes
# ---------- core_3: Python ----------
import Rhino.Geometry as rg
import math

# Input:
#   R (float) circumradius
# Output:
#   Octa (Brep)
#   Pts
#   VtxPlanes

if R is None or R <= 0:
    R = 1.0

r = float(R)

# Octahedron vertices directly from radius
vertices = [
    rg.Point3d( r, 0, 0),
    rg.Point3d(-r, 0, 0),
    rg.Point3d(0,  r, 0),
    rg.Point3d(0, -r, 0),
    rg.Point3d(0, 0,  r),
    rg.Point3d(0, 0, -r)
]

Pts = vertices

# Faces
tol = 0.001
faces_idx = [
    (4,0,2),(4,2,1),(4,1,3),(4,3,0),
    (5,2,0),(5,1,2),(5,3,1),(5,0,3)
]

faces = []
for i,j,k in faces_idx:
    b = rg.Brep.CreateFromCornerPoints(vertices[i],vertices[j],vertices[k],tol)
    if b: faces.append(b)

joined = rg.Brep.JoinBreps(faces, tol)
Octa = joined[0] if joined else None

center = rg.Point3d(0,0,0)

def make_plane(p):
    z = p - center
    z.Unitize()
    ref = rg.Vector3d.ZAxis if abs(z*rg.Vector3d.ZAxis)<0.999 else rg.Vector3d.XAxis
    x = rg.Vector3d.CrossProduct(ref,z); x.Unitize()
    y = rg.Vector3d.CrossProduct(z,x); y.Unitize()
    return rg.Plane(p,x,y)

VtxPlanes = [make_plane(p) for p in Pts]
# ---------- end core_3 ----------
core_4 = Python3Script(R=number_slider)  # -> out, Cube, Pts, VtxPlanes
# ---------- core_4: Python ----------
import Rhino.Geometry as rg
import math

# Grasshopper input:
#   R (float) circumradius, default = 2
# Grasshopper output:
#   Cube (Brep)
#   Pts (list[Point3d])
#   VtxPlanes (list[Plane])

if R is None or R <= 0:
    R = 2.0

r = float(R)

# -----------------------------------------
# Cube (circumscribed)
# -----------------------------------------

s = r / math.sqrt(3.0)

vertices = [
    rg.Point3d( s,  s,  s),
    rg.Point3d( s,  s, -s),
    rg.Point3d( s, -s,  s),
    rg.Point3d( s, -s, -s),
    rg.Point3d(-s,  s,  s),
    rg.Point3d(-s,  s, -s),
    rg.Point3d(-s, -s,  s),
    rg.Point3d(-s, -s, -s)
]

Pts = vertices

# -----------------------------------------
# Faces (6 quad faces)
# -----------------------------------------
tol = 0.001

face_indices = [
    (0, 2, 6, 4),  # +Z face
    (1, 5, 7, 3),  # -Z face
    (0, 1, 3, 2),  # +X
    (4, 6, 7, 5),  # -X
    (0, 4, 5, 1),  # +Y
    (2, 3, 7, 6)   # -Y
]

faces = []
for a, b, c, d in face_indices:
    brep = rg.Brep.CreateFromCornerPoints(vertices[a], vertices[b], vertices[c], vertices[d], tol)
    if brep:
        faces.append(brep)

joined = rg.Brep.JoinBreps(faces, tol)
Cube = joined[0] if joined and len(joined) > 0 else None

# -----------------------------------------
# Center (origin)
# -----------------------------------------
center = rg.Point3d(0, 0, 0)

def make_vertex_plane(origin, center_pt):
    z = origin - center_pt
    if not z.Unitize():
        z = rg.Vector3d.ZAxis

    ref = rg.Vector3d.ZAxis
    if abs(rg.Vector3d.Multiply(z, ref)) > 0.999:
        ref = rg.Vector3d.XAxis

    x = rg.Vector3d.CrossProduct(ref, z)
    if not x.Unitize():
        x = rg.Vector3d.XAxis

    y = rg.Vector3d.CrossProduct(z, x)
    if not y.Unitize():
        y = rg.Vector3d.YAxis

    return rg.Plane(origin, x, y)

VtxPlanes = [make_vertex_plane(p, center) for p in Pts]
# ---------- end core_4 ----------
brep = Brep(core.Tetra)
brep_2 = Brep(core_2.Bipyra)
brep_3 = Brep(core_3.Octa)
brep_4 = Brep(core_4.Cube)
Z = UnitZ(Factor=Slider(8.6, range=-30..30))
balloon_generator = Python3Script(C=circle, d=merge_2)  # -> out, S, Center, Trimmed, CutPlane
# ---------- balloon_generator: Python ----------
import Rhino.Geometry as rg
import math

# Inputs:
# C : Circle
# d : float (distance from sphere center to circle center)

# Outputs:
# S       : Sphere
# Center  : Point3d
# Trimmed : Brep
# CutPlane: Plane

tol = 1e-6

S = None
Center = None
Trimmed = None
CutPlane = None

if C is not None:
    r = C.Radius
    plane = C.Plane
    CutPlane = plane

    # Sphere radius: R^2 = r^2 + d^2
    R = math.sqrt(r * r + d * d)

    # Sphere center: along circle plane normal
    Center = plane.Origin + plane.ZAxis * d
    S = rg.Sphere(Center, R)

    sphere_brep = S.ToBrep()

    # Make a sufficiently large cutting plane surface
    size = R * 4.0 + r * 4.0 + abs(d) * 2.0
    udom = rg.Interval(-size, size)
    vdom = rg.Interval(-size, size)
    cutter = rg.PlaneSurface(plane, udom, vdom).ToBrep()

    # Split sphere by the circle plane
    pieces = sphere_brep.Split(cutter, tol)

    if pieces and len(pieces) > 0:
        kept = None

        # Keep the piece on the same side as the sphere center
        # relative to the cutting plane
        for piece in pieces:
            amp = rg.AreaMassProperties.Compute(piece)
            if amp is None:
                continue

            c = amp.Centroid
            vec = c - plane.Origin

            # signed distance direction test
            side = rg.Vector3d.Multiply(vec, plane.ZAxis)

            # sphere center is always on the side indicated by d
            # if d >= 0, keep positive side; if d < 0, keep negative side
            if d >= 0 and side >= -tol:
                kept = piece
                break
            elif d < 0 and side <= tol:
                kept = piece
                break

        # fallback: choose the piece whose centroid is closer to the sphere center
        if kept is None:
            best_dist = None
            for piece in pieces:
                amp = rg.AreaMassProperties.Compute(piece)
                if amp is None:
                    continue
                dist = amp.Centroid.DistanceTo(Center)
                if best_dist is None or dist < best_dist:
                    best_dist = dist
                    kept = piece

        Trimmed = kept
# ---------- end balloon_generator ----------
Z_2 = UnitZ(Factor=Slider(61.8239, range=-30..300))
move = Move(Geometry=balloon_generator.CutPlane, Motion=expr("-x", Z_2))  # -> Geometry, Transform
move_2 = Move(Geometry=balloon_generator.CutPlane, Motion=Z)  # -> Geometry, Transform
pln = Plane(move_2.Geometry)
brep_5 = Brep(balloon_generator.Trimmed)
pflip = FlipPlane(Plane=pln, ReverseX=False, ReverseY=False, SwapAxes=True)
brep_6 = Brep(brep)
orient = Orient(Geometry=brep_5, Source=move.Geometry, Target=core.VtxPlanes)  # -> Geometry, Transform
orient_2 = Orient(Geometry=graft(merge), Source=pflip, Target=core.VtxPlanes)  # -> Geometry, Transform
debrep = DeconstructBrep(Brep=brep_6)  # -> Faces, Edges, Vertices
volume_2 = Volume(Geometry=brep_6)  # -> Volume, Centroid
curvepoint = PointOnCurve(debrep.Edges, parameter=0.5)
number_slider_2 = Slider(-10.846, range=-20..20)
vec2pt = Vector2Pt(PointA=volume_2.Centroid, PointB=curvepoint, Unitize=False)  # -> Vector, Length
amp = Amplitude(Vector=vec2pt.Vector, Amplitude=Slider(8, range=0..100))
ext = ExtendCurve(Curve=debrep.Edges, Type=0, Start=number_slider_2, End=number_slider_2)
move_3 = Move(Geometry=curvepoint, Motion=amp)  # -> graft(Geometry), Transform
explode = Explode(Curve=ext, Recursive=True)  # -> Segments, Vertices
item = ListItem(List=explode.Vertices, Index=0, Wrap=True)  # -> Item, Item1
vec2pt_2 = Vector2Pt(PointA=item.Item, PointB=item.Item1, Unitize=False)  # -> flatten(Vector), Length
pl = ConstructPlane(Origin=curvepoint, XAxis=vec2pt_2.Vector, YAxis=vec2pt.Vector)
deplane = DeconstructPlane(Plane=pl)  # -> Origin, XAxis, YAxis, ZAxis

# ---- group: section curve
crv = Curve(<curve referenced from the Rhino model>)
explode_2 = Explode(Curve=crv, Recursive=True)  # -> Segments, Vertices
item_2 = ListItem(List=explode_2.Vertices, Index=0, Wrap=True)

# ----
pl_2 = ConstructPlane(Origin=curvepoint, XAxis=deplane.ZAxis, YAxis=deplane.XAxis)  # -> graft(Plane)
arc = Arc3Pt(PointA=item.Item, PointB=move_3.Geometry, PointC=item.Item1)  # -> Arc, Plane, Radius
pl_origin = PlaneOrigin(Base=pl_2, Origin=item.Item1)
pl_origin_2 = PlaneOrigin(Base=pl_2, Origin=item.Item)
pflip_2 = FlipPlane(Plane=pl_origin, ReverseX=False, ReverseY=True, SwapAxes=False)
orient_3 = Orient(Geometry=crv, Source=item_2, Target=pl_origin_2)  # -> Geometry, Transform
cluster = Cluster(G=pl_origin_2, D=Slider(-34, range=-180..180), C=pl_origin_2, P=pl_origin_2)
cluster_2 = Cluster(G=pflip_2, D=Slider(0, range=-180..180), C=pflip_2, P=pflip_2)
orient_4 = Orient(Geometry=crv, Source=item_2, Target=cluster_2)  # -> Geometry, Transform
orient_5 = Orient(Geometry=crv, Source=item_2, Target=cluster)  # -> Geometry, Transform
flip = FlipMatrix(Data=orient_2.Geometry)
swp2 = Sweep2(Rail1=orient_3.Geometry, Rail2=orient_4.Geometry, Sections=arc.Arc, SameHeight=False)
swp1 = Sweep1(Rail=arc.Arc, Sections=orient_5.Geometry, Miter=1)
item_3 = ListItem(List=flip, Index=Slider(0, range=0..10), Wrap=True)
item_4 = ListItem(List=flip, Index=Slider(1, range=0..10), Wrap=True)
panel = Panel(item_4)
cap = CapHoles(Brep=swp1)
sdiff = SolidDifference(BrepsA=flatten(cap), BrepsB=flatten(item_3))
flip_2 = FlipMatrix(Data=orient_2.Geometry)
cull_i = CullIndex(List=flip_2, Indices=[Slider(0, range=0..100), Slider(1, range=0..100)], Wrap=True)
sunion = SolidUnion(Breps=flatten([sdiff, item_4]))

# ---- group: rotate for tetra to have 8 units
pi = Pi(Factor=1)
yz = YZPlane(Origin=volume_2.Centroid)
rotate = Rotate(Geometry=sunion, Angle=pi, Plane=yz)  # -> Geometry, Transform

# ---- group: Config_type
item_5 = ListItem(List=flip_2, Index=0, Wrap=True)
brep_7 = Brep(brep)
sdiff_2 = SolidDifference(BrepsA=brep_7, BrepsB=flatten(item_5))
group = Group(Objects=flatten(item_5))

# ----
brep_8 = Brep(cull_i)

# ---- group: plates
group_2 = Group(Objects=flatten(brep_8))

# ---- group: balloons
group_3 = Group(Objects=orient.Geometry)

# ---- group: core
group_4 = Group(Objects=sunion)

# ----
swatch = ColourSwatch(SwatchColor=RGB(181, 83, 83))  # disabled
swatch_2 = ColourSwatch(SwatchColor=RGB(181, 181, 181))  # disabled
preview = CustomPreview(Geometry=group, Material=swatch)  # disabled
preview_2 = CustomPreview(Geometry=sdiff_2, Material=swatch_2)  # disabled
preview_3 = CustomPreview(Geometry=group_2, Material=ColourSwatch(SwatchColor=RGB(74, 189, 143)))
preview_4 = CustomPreview(Geometry=group_3, Material=ColourSwatch(SwatchColor=RGBA(156, 110, 255, 42)))
preview_5 = CustomPreview(Geometry=group_4, Material=ColourSwatch(SwatchColor=RGB(255, 115, 0)))

# ==== cluster Cluster
D = ClusterInput()
P = ClusterInput()
G = ClusterInput()
C = ClusterInput()
rad = Radians(Degrees=D)
deplane = DeconstructPlane(Plane=P)  # -> Origin, XAxis, YAxis, ZAxis
rot3d = Rotate3D(Geometry=G, Angle=rad, Center=C, Axis=deplane.XAxis)  # -> Geometry, Transform
G_2 = ClusterOutput(rot3d.Geometry)
